# Requirement set Requisitos_NASH_Planta_MCP_ER_Prop_V1e_ (R2020a)

## 1 [Requisitos_NASH_Planta_MCP_ER_Prop_V1e_!MCP_reqs] References to Requisitos_NASH_Planta_MCP_ER_Prop_V1e_.xlsx (MCP_reqs) (Container)
Read-only references to Microsoft Excel document.
Comment: Deleted: 001-F-EIX-001
Deleted: 001-F-EIX-002
Deleted: 001-F-EIX-003
Deleted: 001-F-EIX-004
Deleted: 001-F-EIX-005
Deleted: 001-F-HEL-001
Deleted: 001-F-HEL-002
Deleted: 001-F-HEL-003
Deleted: 001-F-HEL-004
Deleted: 001-F-HEL-005
Deleted: 001-F-HEL-006
Deleted: 001-F-HEL-007
Updated: 001-F-MCP-001. Properties: description, summary
Deleted: 001-N-EIX-001
Deleted: 001-N-EIX-002
Deleted: 001-N-EIX-003
Deleted: 001-N-EIX-004
Deleted: 001-N-EIX-005
Deleted: 001-N-EIX-006
Deleted: 001-N-EIX-007
Deleted: 001-N-EIX-008
Comment: There are no changes

### 1.1 [001-F-MCP-001] O modelo do MCP deve representar dinamicamente as variáveis lidas pelo IPMS.

### 1.2 [001-F-MCP-002] O modelo do MCP deve receber estímulo de sinal vindo do IPMS.

### 1.3 [001-F-MCP-003] No estado do motor desligado, o modelo do MCP deve ignorar comandos de demanda de rotação.

### 1.4 [001-F-MCP-004] No estado de motor parado, o modelo do MCP deve representar o valor de rotação igual a 0 RPM.

### 1.5 [001-F-MCP-005] Quando em ralenti, o modelo do MCP deve representar o valor de rotação igual a 600 RPM.

### 1.6 [001-F-MCP-006] No estado de motor rodando, o modelo do MCP deve representar a dinâmica de rotação do motor de acordo com a demanda e com o estado da engrenagem reversora.

### 1.7 [001-F-MCP-007] A dinâmida de rotação do modelo do MCP deve apresentar o comportamento do motor representado no EST-156.

### 1.8 [001-F-MCP-008] Por meio da IHM do simulador, o modelo do MCP deve permitir a inserção de falhas pelo operador do sistema.

### 1.9 [001-F-MCP-008-1] Por meio da IHM do simulador, o modelo do MCP deve permitir a inserção de falha pressão de boost diferente de zero.

### 1.10 [001-F-MCP-008-2] Por meio da IHM do simulador, o modelo do MCP deve permitir a inserção de falha temperatura de exaustão fora da faixa de operação normal.

### 1.11 [001-F-MCP-008-3] Por meio da IHM do simulador, o modelo do MCP deve permitir a inserção de falha do sinal de rotação do MCP.

### 1.12 [001-F-MCP-008-4] Por meio da IHM do simulador, o modelo do MCP deve permitir a inserção de falha de pressão de óleo lubrificante.

### 1.13 [001-F-MCP-008-5] Por meio da IHM do simulador, o modelo do MCP deve permitir a inserção de falha de temperatura de água de resfriamento.

### 1.14 [001-F-MCP-008-6] Por meio da IHM do simulador, o modelo do MCP deve permitir a inserção de falha de pressão de ar.

### 1.15 [001-F-MCP-009] Os valores dos sinais de temperatura de exaustão (MCPBE0.21 a 26) devem possuir dinâmica linear de 1a ordem baseada nos dados do IPQM-REL-156.

### 1.16 [001-F-MCP-010] O modelo do MCP deve representar o consumo instantaneo de combustível em L/h de acordo com a figura D.1. do EST-270.

### 1.17 [001-F-MCP-011] O modelo do MCP deve representar a potência do motor em kW de acordo com a figura D.1 do EST-270.

### 1.18 [001-F-MCP-012] A geração dos valores da potência de saída do modelo deve considerar valores em regime estático (sistema elástico).

### 1.19 [001-F-MCP-013] O torque calculado no modelo do motor (MCPBE1.3) deve ser um sinal de saída do modelo do MCP para a engrenagem reversora.

### 1.20 [001-F-MCP-014] As saídas referentes aos alarmes devem basear-se nos valores disponíveis em (YANMAR, 2003)

### 1.21 [001-F-MCP-015] Quando virando, o modelo deve representar a dinâmica do motor entre 600 e 2000 rpm, conforme detalhado no IPQM-REL-156.

### 1.22 [001-F-MCP-016] O comportamento do sinal da temperatura da água de resfriamento(MCPBE0.19) deve ser implementado por uma TF de primeira ordem de regime estacionário entre Tambiente e 90°C de acordo com dados do EST-270.

### 1.23 [001-F-MCP-017] O sinal simulado de pressão de boost (MCPBE0.20) do MCPBE deve ser um sinal constante (0 MPa em unidade de engenharia), de acordo com YANMAR,2003.