% Requirement links of MCP_Model_macro_complete.slx (R2020a)

block :115 implements Requisitos_NASH_Planta_MCP_ER_Prop_V1e_.slreqx#4: 001-F-MCP-003: No estado do motor desligado, o modelo do MCP deve ignorar comandos de demanda de rotação.
block :226 implements Requisitos_NASH_Planta_MCP_ER_Prop_V1e_.slreqx#11: 001-F-MCP-008-2: Por meio da IHM do simulador, o modelo do MCP deve permitir a inserção de falha temperatura de exaustão fora da faixa de operação normal.
block :226 implements Requisitos_NASH_Planta_MCP_ER_Prop_V1e_.slreqx#16: 001-F-MCP-009: Os valores dos sinais de temperatura de exaustão (MCPBE0.21 a 26) devem possuir dinâmica linear de 1a ordem baseada nos dados do IPQM-REL-156.
block :232 implements Requisitos_NASH_Planta_MCP_ER_Prop_V1e_.slreqx#4: 001-F-MCP-003: No estado do motor desligado, o modelo do MCP deve ignorar comandos de demanda de rotação.
block :24 implements Requisitos_NASH_Planta_MCP_ER_Prop_V1e_.slreqx#17: 001-F-MCP-010: O modelo do MCP deve representar o consumo instantaneo de combustível em L/h de acordo com a figura D.1. do EST-270.
block :59 implements Requisitos_NASH_Planta_MCP_ER_Prop_V1e_.slreqx#11: 001-F-MCP-008-2: Por meio da IHM do simulador, o modelo do MCP deve permitir a inserção de falha temperatura de exaustão fora da faixa de operação normal.
block :59 implements Requisitos_NASH_Planta_MCP_ER_Prop_V1e_.slreqx#16: 001-F-MCP-009: Os valores dos sinais de temperatura de exaustão (MCPBE0.21 a 26) devem possuir dinâmica linear de 1a ordem baseada nos dados do IPQM-REL-156.
block :74 implements Requisitos_NASH_Planta_MCP_ER_Prop_V1e_.slreqx#2: 001-F-MCP-001: O modelo do MCP deve representar dinamicamente as variáveis lidas pelo IPMS.
block :74 implements Requisitos_NASH_Planta_MCP_ER_Prop_V1e_.slreqx#3: 001-F-MCP-002: O modelo do MCP deve receber estímulo de sinal vindo do IPMS.
block :74 implements Requisitos_NASH_Planta_MCP_ER_Prop_V1e_.slreqx#9: 001-F-MCP-008: Por meio da IHM do simulador, o modelo do MCP deve permitir a inserção de falhas pelo operador do sistema.
block :8 implements Requisitos_NASH_Planta_MCP_ER_Prop_V1e_.slreqx#14: 001-F-MCP-008-5: Por meio da IHM do simulador, o modelo do MCP deve permitir a inserção de falha de temperatura de água de resfriamento.
block :8 implements Requisitos_NASH_Planta_MCP_ER_Prop_V1e_.slreqx#23: 001-F-MCP-016: O comportamento do sinal da temperatura da água de resfriamento(MCPBE0.19) deve ser implementado por uma TF de primeira ordem de regime estacionário entre Tambiente e 90°C de acordo com dados do EST-270.
block :88 implements Requisitos_NASH_Planta_MCP_ER_Prop_V1e_.slreqx#20: 001-F-MCP-013: O torque calculado no modelo do motor (MCPBE1.3) deve ser um sinal de saída do modelo do MCP para a engrenagem reversora.
block :90 implements Requisitos_NASH_Planta_MCP_ER_Prop_V1e_.slreqx#10: 001-F-MCP-008-1: Por meio da IHM do simulador, o modelo do MCP deve permitir a inserção de falha pressão de boost diferente de zero.
block :90 implements Requisitos_NASH_Planta_MCP_ER_Prop_V1e_.slreqx#24: 001-F-MCP-017: O sinal simulado de pressão de boost (MCPBE0.20) do MCPBE deve ser um sinal constante (0 MPa em unidade de engenharia), de acordo com YANMAR,2003.
block :94 implements Requisitos_NASH_Planta_MCP_ER_Prop_V1e_.slreqx#8: 001-F-MCP-007: A dinâmida de rotação do modelo do MCP deve apresentar o comportamento do motor representado no EST-156.
block :94 implements Requisitos_NASH_Planta_MCP_ER_Prop_V1e_.slreqx#12: 001-F-MCP-008-3: Por meio da IHM do simulador, o modelo do MCP deve permitir a inserção de falha do sinal de rotação do MCP.
block :94 implements Requisitos_NASH_Planta_MCP_ER_Prop_V1e_.slreqx#13: 001-F-MCP-008-4: Por meio da IHM do simulador, o modelo do MCP deve permitir a inserção de falha de pressão de óleo lubrificante.
block :97 implements Requisitos_NASH_Planta_MCP_ER_Prop_V1e_.slreqx#18: 001-F-MCP-011: O modelo do MCP deve representar a potência do motor em kW de acordo com a figura D.1 do EST-270.
block :97 implements Requisitos_NASH_Planta_MCP_ER_Prop_V1e_.slreqx#19: 001-F-MCP-012: A geração dos valores da potência de saída do modelo deve considerar valores em regime estático (sistema elástico).