% Requirement links of discrete_event_state_MCP_EngRev.slx (R2020a)

block :1 implements Requisitos_NASH_Planta_MCP_ER_Prop_V1e_.slreqx#6: 001-F-MCP-005: Quando em ralenti, o modelo do MCP deve representar o valor de rotação igual a 600 RPM.
block :1:29 implements Requisitos_NASH_Planta_MCP_ER_Prop_V1e_.slreqx#7: 001-F-MCP-006: No estado de motor rodando, o modelo do MCP deve representar a dinâmica de rotação do motor de acordo com a demanda e com o estado da engrenagem reversora.
block :1:30 implements Requisitos_NASH_Planta_MCP_ER_Prop_V1e_.slreqx#7: 001-F-MCP-006: No estado de motor rodando, o modelo do MCP deve representar a dinâmica de rotação do motor de acordo com a demanda e com o estado da engrenagem reversora.
block :1:31 implements Requisitos_NASH_Planta_MCP_ER_Prop_V1e_.slreqx#7: 001-F-MCP-006: No estado de motor rodando, o modelo do MCP deve representar a dinâmica de rotação do motor de acordo com a demanda e com o estado da engrenagem reversora.
block :1:43 implements Requisitos_NASH_Planta_MCP_ER_Prop_V1e_.slreqx#4: 001-F-MCP-003: No estado do motor desligado, o modelo do MCP deve ignorar comandos de demanda de rotação.
block :1:43 implements Requisitos_NASH_Planta_MCP_ER_Prop_V1e_.slreqx#7: 001-F-MCP-006: No estado de motor rodando, o modelo do MCP deve representar a dinâmica de rotação do motor de acordo com a demanda e com o estado da engrenagem reversora.
block :1:43 implements Requisitos_NASH_Planta_MCP_ER_Prop_V1e_.slreqx#22: 001-F-MCP-015: Quando virando, o modelo deve representar a dinâmica do motor entre 600 e 2000 rpm, conforme detalhado no IPQM-REL-156.
block :1:43 implements Requisitos_NASH_Planta_MCP_ER_Prop_V1e_.slreqx#5: 001-F-MCP-004: No estado de motor parado, o modelo do MCP deve representar o valor de rotação igual a 0 RPM.
block :1:44 implements Requisitos_NASH_Planta_MCP_ER_Prop_V1e_.slreqx#8: 001-F-MCP-007: A dinâmida de rotação do modelo do MCP deve apresentar o comportamento do motor representado no EST-156.